vi "IndoorMonitoring.gviweb"   [LabVIEW NXG 3.0.0]
panel controls:
  "Tab": i32
  "Node 1 Files": i32 = -1
  "Node 2 Files": i32 = -1
panel indicators:
  "Node 1 Temp": f64
  "Node 1 RH": f64
  "Node 2 Temp": f64
  "Node 2 RH": f64
  "String Info Node 1": string
  "String Info": string
  "status": bool
  "AVG_Plot Node 1": cluster{"Element 1": f64[], "Element 2": f64[]}[]
  "Update Time": string
  "File Data Node 1": cluster{"Element 1": f64[], "Element 2": f64[]}[]
  "T HistMinMax node 1": cluster{"Element 1": f64[], "Element 2": f64[]}[]
  "RH HistMinMax node 1": cluster{"Element 1": f64[], "Element 2": f64[]}[]
  "AVG_Plot Node 2": cluster{"Element 1": f64[], "Element 2": f64[]}[]
  "T HistMinMax node 2": cluster{"Element 1": f64[], "Element 2": f64[]}[]
  "RH HistMinMax node 2": cluster{"Element 1": f64[], "Element 2": f64[]}[]
  "File Data Node 2": cluster{"Element 1": f64[], "Element 2": f64[]}[]
  "T summary node 1": string
  "T summary node 2": string
  "RH summary node 1": string
  "RH summary node 2": string
uses:
  NI::HTTP::Open HTTP Handle.gvi
  WebApp::UI_Actuals.gvi
  WebApp::UI_Averaged.gvi
  WebApp::NodeCommunication::GetFileList.gvi
  WebApp::UI_HistoricalMinMax.gvi
  WebApp::UI_Historical.gvi
diagram:
  Property Node(instance in=reference to "Tab", "Value"=0) -> (instance out=w1)
  w2 = ["192.168.178.67", "192.168.178.144"]  # Ip adresses of nodes
  w3 = "http://%s:8002/IndoorMonitoring/"  # Base string without IP
  for {
    w4 = each element of w2
    Format Into String(formatString=w3, w4) -> w6
    append w6 to w5
  }
  # File list ref for the 2 nodes
  Build Array(reference to "Node 1 Files", reference to "Node 2 Files") -> w7
  call "Open HTTP Handle.gvi"() -> (client handle out=w8)
  s1 = w5  # shift register
  s2 = w8  # shift register
  s3 = 10  # shift register
  while (after w1) {
    w9 = $Tab
    event (timeout = s3) (after w9) {
      on Timeout {
        Get Date And Time String(want seconds? (F)=TRUE) -> (time string=w14)
        $"Update Time" <- w14
        call "UI_Actuals.gvi"(Input=s2, Base URL=s1) -> (Output=w15, Debug=w16, Actuals=w17, Error out=w18)
        call "UI_Averaged.gvi"(Input=w15, Base URL=s1, Error=w18) -> (Output=w11, Graphs 1=w19, Graphs 2=w20, Error out=w12)
        $"AVG_Plot Node 1" <- w19
        Array Index(array=w16) -> (out0[_]=w21, out1[_]=w22)
        $"String Info Node 1" <- w21
        $"AVG_Plot Node 2" <- w20
        $"String Info" <- w22
        Array Index(array=w17) -> (out0[_]=w23, out1[_]=w24)
        Property Node(instance in=w23) -> ("Temp"=w25, "RH"=w26)
        $"Node 1 Temp" <- w25
        $"Node 1 RH" <- w26
        Property Node(instance in=w24) -> ("Temp"=w27, "RH"=w28)
        $"Node 2 Temp" <- w27
        $"Node 2 RH" <- w28
        w10 = s1
        w13 = 15000
      }
      on "Tab" Value changed {
        Event Data() -> ("New Value"=w29)
        case (w29) {
          frame 0, Default {
            w10 = s1
            w11 = s2
            w12 = default
          }
          frame 1 {
            # Update the file list of each node
            s4 = s2  # shift register
            for {
              w30 = each element of s1
              w31 = each element of w7
              call "GetFileList.gvi"(client handle=s4, BaseURL=w30) -> (client handle out=w32, value=w33, error out=w12)
              Property Node(instance in=w31, "Items"=w33, "Value"=0)
              next s4 = w32
            }
            w10 = s1
            w11 = s4
          }
          frame 2, 3 {
            call "UI_HistoricalMinMax.gvi"(Input=s2, Base URL=s1) -> (Output=w11, GraphsT=w34, GraphsRH=w35, Error out=w12, T strings=w36, RH Strings=w37)
            # Get the hostorical min and max for each node - takes some time to process
            Array Index(array=w36) -> (out0[_]=w38, out1[_]=w39)
            $"T summary node 1" <- w38
            $"T summary node 2" <- w39
            Array Index(array=w37) -> (out0[_]=w40, out1[_]=w41)
            $"RH summary node 1" <- w40
            $"RH summary node 2" <- w41
            Delete From Array(inArray=w34, length (1)=2) -> (outArray=w42, deleted=w43)
            $"T HistMinMax node 1" <- w42
            $"T HistMinMax node 2" <- w43
            Delete From Array(inArray=w35, length (1)=2) -> (outArray=w44, deleted=w45)
            $"RH HistMinMax node 1" <- w44
            $"RH HistMinMax node 2" <- w45
            w10 = s1
          }
        }
        w13 = s3
      }
      on "Node 1 Files" Value changed; "Node 2 Files" Value changed {
        for {
          w46 = each element of w7
          Property Node(instance in=w46) -> ("Items"=w48, "Value"=w49)
          Array Index(array=w48) -> (out0[w49]=w50)
          append w50 to w47
        }
        call "UI_Historical.gvi"(Input=s2, Base URL=s1, Filenames=w47) -> (Output=w11, Graphs=w51, Graphs_2=w52, Error out=w12)
        $"File Data Node 1" <- w51
        $"File Data Node 2" <- w52
        w10 = s1
        w13 = s3
      }
    }
    Property Node(instance in=w12) -> ("status"=w53)
    $status <- w53
    next s1 = w10
    next s2 = w11
    next s3 = w13
    stop if FALSE
  }
