vi "GetDebug.gvi"   [LabVIEW NXG 3.0.0]
inputs:
  "client handle": "Client Handle.gtype"
  "BaseURL": string
  "error in": error
outputs:
  "client handle out": "Client Handle.gtype"
  "error out": error
  "Debug": "Debug.gtype"
types:
  "Client Handle.gtype" = u32
  "Debug.gtype" = cluster{"Rev": string, "Location": string, "LoopIdx": i32, "PiCoreTemp": f64, "Error": error}
uses:
  NI::HTTP::GET.gvi
diagram:
  case ($"error in") {
    frame Error, Default {
      w1 = $"client handle"
      w2 = default
      w3 = $"error in"
    }
    frame No Error {
      Format Into String(formatString="%s%s", errIn=$"error in", $BaseURL, "GetDebug") -> (outString=w4, errOut=w5)
      # Example: http://192.168.178.191:8002/IndoorMonitoring/GetDebug
      call "GET.gvi"(client handle=$"client handle", url=w4, error in=w5) -> (client handle out=w1, body=w6, error out=w7)
      Unflatten From JSON(JSON string=w6, error in (no error)=w7, type and defaults="Debug.gtype" {all zero or empty}) -> (error out=w3, value=w2)
    }
  }
  $"client handle out" <- w1
  $Debug <- w2
  $"error out" <- w3
