vi "GetFileData.gvi"   [LabVIEW NXG 3.0.0]
inputs:
  "client handle": "Client Handle.gtype"
  "Error in": error
  "BaseURL": string
  "FileName": string
outputs:
  "client handle out": "Client Handle.gtype"
  "FileData": "AVGData.gtype"
  "error out": error
types:
  "Client Handle.gtype" = u32
  "AVGData.gtype" = cluster{"Time": f64[], "Temp": f64[], "RH": f64[]}
uses:
  NI::HTTP::GET.gvi
diagram:
  case ($"Error in") {
    frame Error, Default {
      w1 = $"client handle"
      w2 = $"Error in"
      w3 = default
    }
    frame No Error {
      Format Into String(formatString="%s%s?FileName=%s", errIn=$"Error in", $BaseURL, "GetFileData", $FileName) -> (outString=w4, errOut=w5)
      # Example: http://192.168.178.191:8002/IndoorMonitoring/GetFileData?FileName=20190505.txt
      call "GET.gvi"(client handle=$"client handle", url=w4, error in=w5) -> (client handle out=w1, body=w6, error out=w7)
      w8 = "AVGData.gtype" {all zero or empty}  # FileData
      Unflatten From JSON(JSON string=w6, error in (no error)=w7, type and defaults=w8) -> (error out=w2, value=w3)
    }
  }
  $"client handle out" <- w1
  $FileData <- w3
  $"error out" <- w2
