vi "GetFileList.gvi"   [LabVIEW NXG 3.0.0]
inputs:
  "client handle": "Client Handle.gtype"
  "BaseURL": string
  "Error In": error
outputs:
  "client handle out": "Client Handle.gtype"
  "value": string[]
  "error out": error
types:
  "Client Handle.gtype" = u32
uses:
  NI::HTTP::GET.gvi
diagram:
  case ($"Error In") {
    frame Error, Default {
      w1 = $"client handle"
      w2 = default
      w3 = $"Error In"
    }
    frame No Error {
      Format Into String(formatString="%s%s", errIn=$"Error In", $BaseURL, "GetFileNames") -> (outString=w4, errOut=w5)
      call "GET.gvi"(client handle=$"client handle", url=w4, error in=w5) -> (client handle out=w1, body=w6, error out=w7)
      w8 = string[] []  # FileList
      Unflatten From JSON(JSON string=w6, error in (no error)=w7, type and defaults=w8) -> (error out=w3, value=w2)
    }
  }
  $"client handle out" <- w1
  $value <- w2
  $"error out" <- w3
