vi "GetHistoricalMinMax.gvi"   [LabVIEW NXG 3.0.0]
inputs:
  "client handle": "Client Handle.gtype"
  "BaseURL": string
  "Error in": error
outputs:
  "client handle out": "Client Handle.gtype"
  "HistMinMax": "HistMinMax.gtype"
  "error out": error
types:
  "Client Handle.gtype" = u32
  "HistMinMax.gtype" = cluster{"Time": f64[], "Temp Max": f64[], "Temp Min": f64[], "RH Max": f64[], "RH Min": f64[]}
uses:
  NI::HTTP::GET.gvi
diagram:
  case ($"Error in") {
    frame Error, Default {
      w1 = $"client handle"
      w2 = $"Error in"
      w3 = default
    }
    frame No Error {
      Format Into String(formatString="%s%s", errIn=$"Error in", $BaseURL, "GetHistoricalMinMax") -> (outString=w4, errOut=w5)
      call "GET.gvi"(client handle=$"client handle", url=w4, error in=w5) -> (client handle out=w1, body=w6, error out=w7)
      Unflatten From JSON(JSON string=w6, error in (no error)=w7, type and defaults="HistMinMax.gtype" {all zero or empty}) -> (error out=w2, value=w3)
    }
  }
  $"client handle out" <- w1
  $HistMinMax <- w3
  $"error out" <- w2
