vi "UI_Actuals.gvi"   [LabVIEW NXG 3.0.0]
inputs:
  "Input": "Client Handle.gtype"
  "Base URL": string[]
  "Error": error
outputs:
  "Output": "Client Handle.gtype"
  "Error out": error
  "Debug": string[]
  "Actuals": "ActualValues.gtype"[]
types:
  "Client Handle.gtype" = u32
  "ActualValues.gtype" = cluster{"Time": f64, "Temp": f64, "RH": f64}
uses:
  WebApp::NodeCommunication::GetActualValues.gvi
  WebApp::NodeCommunication::GetDebug.gvi
diagram:
  case ($Error) {
    frame Error, Default {
      w1 = $Input
      w2 = $Error
      w3 = default
      w4 = default
    }
    frame No Error {
      s1 = $Input  # shift register
      for {
        w5 = each element of $"Base URL"
        call "GetActualValues.gvi"(client handle=s1, BaseURL=w5, error in=$Error) -> (client handle out=w7, ActualValues=w8, error out=w9)
        call "GetDebug.gvi"(client handle=w7, BaseURL=w5, error in=w9) -> (client handle out=w10, Debug=w11, error out=w12)
        Property Node(instance in=w11) -> ("Location"=w13, "Rev"=w14, "PiCoreTemp"=w15, "Error"=w16)
        Property Node(instance in=w16) -> ("code"=w17)
        Format Into String(formatString="%s Rev: %s PiCoreTemp: %.3f DegC Error: %d", w13, w14, w15, w17) -> w18
        append w8 to w3
        append w18 to w4
        append w12 to w6
        next s1 = w10
      }
      Merge Errors(w6) -> (error out=w2)
      w1 = s1
    }
  }
  $Debug <- w4
  $Output <- w1
  $"Error out" <- w2
  $Actuals <- w3
