vi "UI_Averaged.gvi"   [LabVIEW NXG 3.0.0]
inputs:
  "Input": "Client Handle.gtype"
  "Error": error
  "Base URL": string[]
outputs:
  "Output": "Client Handle.gtype"
  "Error out": error
  "Graphs 1": cluster{"Element 1": f64[], "Element 2": f64[]}[]
  "Graphs 2": cluster{"Element 1": f64[], "Element 2": f64[]}[]
types:
  "Client Handle.gtype" = u32
uses:
  WebApp::NodeCommunication::GetAveraged.gvi
diagram:
  case ($Error) {
    frame Error, Default {
      w1 = $Input
      w2 = $Error
      w3 = default
    }
    frame No Error {
      s1 = $Input  # shift register
      for {
        w4 = each element of $"Base URL"
        call "GetAveraged.gvi"(client handle=s1, BaseURL=w4, Error in=$Error) -> (client handle out=w6, AveragedData=w7, error out=w8)
        Property Node(instance in=w7) -> ("Time"=w9, "Temp"=w10, "RH"=w11)
        Build Cluster(w9, w10) -> w12
        Build Cluster(w9, w11) -> w13
        Build Array(w12, w13) -> w14
        concatenate w14 onto w3
        append w8 to w5
        next s1 = w6
      }
      Merge Errors(w5) -> (error out=w2)
      w1 = s1
    }
  }
  Delete From Array(inArray=w3, length (1)=2) -> (outArray=w15, deleted=w16)
  $"Graphs 1" <- w15
  $"Graphs 2" <- w16
  $Output <- w1
  $"Error out" <- w2
