vi "UI_FileList.gvi"   [LabVIEW NXG 3.0.0]
inputs:
  "Input": "Client Handle.gtype"
  "Base URL": string[]
  "Error": error
  "ControlRefs": "Listbox reference"[]
outputs:
  "Output": "Client Handle.gtype"
  "Error out": error
types:
  "Client Handle.gtype" = u32
uses:
  WebApp::NodeCommunication::GetFileList.gvi
diagram:
  case ($Error) {
    frame Error, Default {
      w1 = $Input
      w2 = $Error
    }
    frame No Error {
      s1 = $Input  # shift register
      for {
        w3 = each element of $"Base URL"
        w4 = each element of $ControlRefs
        call "GetFileList.gvi"(client handle=s1, BaseURL=w3, Error In=$Error) -> (client handle out=w6, value=w7, error out=w8)
        Property Node(instance in=w4, "Items"=w7, "Value"=0)
        append w8 to w5
        next s1 = w6
      }
      Merge Errors(w5) -> (error out=w2)
      w1 = s1
    }
  }
  $Output <- w1
  $"Error out" <- w2
