vi "UIFunctions_FormatMinMaxString.gvi"   [LabVIEW NXG 3.0.0]
# Uses the debug info and HistMinMax data to format a string about the nodes max and min.
inputs:
  "Error In": error
  "RH?": bool, required
  "debug in": "Debug.gtype", required
  "HistMinMax": "HistMinMax.gtype", required
outputs:
  "Error Out": error
  "MinMaxString": string
types:
  "HistMinMax.gtype" = cluster{"Time": f64[], "Temp Max": f64[], "Temp Min": f64[], "RH Max": f64[], "RH Min": f64[]}
  "Debug.gtype" = cluster{"Rev": string, "Location": string, "LoopIdx": i32, "PiCoreTemp": f64, "Error": error}
diagram:
  case ($"Error In") {
    frame Error, Default {
      w1 = $"Error In"
      w2 = default
    }
    frame No Error {
      Property Node(instance in=$"debug in") -> ("Location"=w3)
      Property Node(instance in=$HistMinMax) -> ("RH Max"=w4, "Temp Max"=w5, "RH Min"=w6, "Temp Min"=w7, "Time"=w8)
      Select(s=$"RH?", t=w4, f=w5) -> w9
      Array Max And Min(array=w9) -> (max index(es)=w10, max value=w11)
      Select(s=$"RH?", t=w6, f=w7) -> w12
      Array Max And Min(array=w12) -> (min index(es)=w13, min value=w14)
      Array Index(array=w8) -> (out0[w10]=w15)
      To Time Stamp(number=w15) -> w16
      Format Date Time String(time format string (%c)="%d %B %y", time stamp=w16) -> (date/time string=w17)
      Array Index(array=w8) -> (out0[w13]=w18)
      To Time Stamp(number=w18) -> w19
      Format Date Time String(time format string (%c)="%d %B %y", time stamp=w19) -> (date/time string=w20)
      Select(s=$"RH?", t="Node: %s RH: Max %.3f at %s - Min %.3f at %s", f="Node: %s Temperature: Max %.3f at %s - Min %.3f at %s") -> w21
      Format Into String(formatString=w21, w3, w11, w17, w14, w20) -> w2
      w1 = $"Error In"
    }
  }
  $MinMaxString <- w2
  $"Error Out" <- w1
