vi "UIFunctions_GetActualValues.gvi"   [LabVIEW NXG 3.0.0]
inputs:
  "Error In": error
  "UIFunction_In": "UI_FunctionProps.gtype" = {"HTTP_BaseStrings"=["192.168.178.67", "192.168.178.144", "192.168.178.191"], "HTTP client handle"=0, "NodesOnline"=[], "ListBoxRef"=refnum}, required
outputs:
  "Error Out": error
  "UIFunction_Out": "UI_FunctionProps.gtype"
  "ActualValues": "ActualValues.gtype"[]
types:
  "ActualValues.gtype" = cluster{"Time": f64, "Temp": f64, "RH": f64}
  "Client Handle.gtype" = u32
  "UI_FunctionProps.gtype" = cluster{"HTTP_BaseStrings": string[], "HTTP client handle": "Client Handle.gtype", "NodesOnline": bool[], "ListBoxRef": "Listbox reference"}
uses:
  WebApp::NodeCommunication::GetActualValues.gvi
diagram:
  case ($"Error In") {
    frame Error, Default {
      w1 = $"Error In"
      w2 = $UIFunction_In
      w3 = default
    }
    frame No Error {
      Property Node(instance in=$UIFunction_In) -> ("HTTP client handle"=w4, "HTTP_BaseStrings"=w5, "NodesOnline"=w6, instance out=w2)
      s1 = w4  # shift register
      for {
        w7 = each element of w6
        w8 = each element of w5
        case (w7) {
          frame False, Default {
            w10 = s1
            w11 = $"Error In"
            w12 = "ActualValues.gtype" {"Time"=-1, "Temp"=-1, "RH"=-1}
          }
          frame True {
            call "GetActualValues.gvi"(client handle=s1, BaseURL=w8, error in=$"Error In") -> (client handle out=w10, ActualValues=w12, error out=w11)
          }
        }
        append w11 to w9
        append w12 to w3
        next s1 = w10
      }
      Merge Errors(w9) -> (error out=w1)
    }
  }
  $UIFunction_Out <- w2
  $ActualValues <- w3
  $"Error Out" <- w1
