vi "UIFunctions_GetAveragedValues.gvi"   [LabVIEW NXG 3.0.0]
inputs:
  "Error In": error
  "UIFunction_In": "UI_FunctionProps.gtype" = {"HTTP_BaseStrings"=["192.168.178.67", "192.168.178.144", "192.168.178.191"], "HTTP client handle"=0, "NodesOnline"=[], "ListBoxRef"=refnum}, required
outputs:
  "Error Out": error
  "UIFunction_Out": "UI_FunctionProps.gtype"
  "T Graphs": cluster{"Element 1": f64[], "Element 2": f64[]}[]
  "RH Graphs": cluster{"Element 1": f64[], "Element 2": f64[]}[]
types:
  "Client Handle.gtype" = u32
  "UI_FunctionProps.gtype" = cluster{"HTTP_BaseStrings": string[], "HTTP client handle": "Client Handle.gtype", "NodesOnline": bool[], "ListBoxRef": "Listbox reference"}
uses:
  WebApp::NodeCommunication::GetAveraged.gvi
diagram:
  case ($"Error In") {
    frame Error, Default {
      w1 = $"Error In"
      w2 = $UIFunction_In
      w3 = default
      w4 = default
    }
    frame No Error {
      Property Node(instance in=$UIFunction_In) -> ("HTTP client handle"=w5, "HTTP_BaseStrings"=w6, "NodesOnline"=w7, instance out=w2)
      s1 = w5  # shift register
      for {
        w8 = each element of w7
        w9 = each element of w6
        case (w8) {
          frame False, Default {
            w15 = cluster{"Element 1": f64[], "Element 2": f64[]} {"Element 1"=[NaN], "Element 2"=[NaN]}
            w11 = s1
            w12 = $"Error In"
            w13 = w15
            w14 = w15
          }
          frame True {
            call "GetAveraged.gvi"(client handle=s1, BaseURL=w9, Error in=$"Error In") -> (client handle out=w11, AveragedData=w16, error out=w12)
            Property Node(instance in=w16) -> ("Time"=w17, "Temp"=w18, "RH"=w19)
            Build Cluster(w17, w18) -> w14
            Build Cluster(w17, w19) -> w13
          }
        }
        append w12 to w10
        append w14 to w3
        append w13 to w4
        next s1 = w11
      }
      Merge Errors(w10) -> (error out=w1)
    }
  }
  $UIFunction_Out <- w2
  $"T Graphs" <- w3
  $"RH Graphs" <- w4
  $"Error Out" <- w1
