vi "UIFunctions_GetDebug.gvi"   [LabVIEW NXG 3.0.0]
# Reads the debug info from all nodes and outputs them as cluser and string
inputs:
  "Error In": error
  "UIFunction_In": "UI_FunctionProps.gtype" = {"HTTP_BaseStrings"=["192.168.178.67", "192.168.178.144", "192.168.178.191"], "HTTP client handle"=0, "NodesOnline"=[], "ListBoxRef"=refnum}, required
outputs:
  "Error Out": error
  "UIFunction_Out": "UI_FunctionProps.gtype"
  "DebugStrings": string[]
  "DebugCluster": "Debug.gtype"[]
types:
  "Debug.gtype" = cluster{"Rev": string, "Location": string, "LoopIdx": i32, "PiCoreTemp": f64, "Error": error}
  "Client Handle.gtype" = u32
  "UI_FunctionProps.gtype" = cluster{"HTTP_BaseStrings": string[], "HTTP client handle": "Client Handle.gtype", "NodesOnline": bool[], "ListBoxRef": "Listbox reference"}
uses:
  WebApp::NodeCommunication::GetDebug.gvi
diagram:
  case ($"Error In") {
    frame Error, Default {
      w1 = $"Error In"
      w2 = $UIFunction_In
      w3 = default
      w4 = default
    }
    frame No Error {
      Property Node(instance in=$UIFunction_In) -> ("HTTP client handle"=w5, "HTTP_BaseStrings"=w6, "NodesOnline"=w7, instance out=w2)
      s1 = w5  # shift register
      for {
        w8 = each element of w7
        w9 = each element of w6
        case (w8) {
          frame False, Default {
            w11 = s1
            w12 = $"Error In"
            w13 = "Offline"
            w14 = default
          }
          frame True {
            call "GetDebug.gvi"(client handle=s1, BaseURL=w9, error in=$"Error In") -> (client handle out=w11, Debug=w14, error out=w12)
            Property Node(instance in=w14) -> ("Location"=w15, "Rev"=w16, "PiCoreTemp"=w17, "Error"=w18)
            Property Node(instance in=w18) -> ("code"=w19)
            Format Into String(formatString="%s Rev: %s PiCoreTemp: %.3f DegC Error: %d", w15, w16, w17, w19) -> w13
          }
        }
        append w12 to w10
        append w13 to w3
        append w14 to w4
        next s1 = w11
      }
      Merge Errors(w10) -> (error out=w1)
    }
  }
  $UIFunction_Out <- w2
  $DebugStrings <- w3
  $DebugCluster <- w4
  $"Error Out" <- w1
