vi "UIFunctions_GetFileData.gvi"   [LabVIEW NXG 3.0.0]
inputs:
  "Error In": error
  "UIFunction_In": "UI_FunctionProps.gtype" = {"HTTP_BaseStrings"=["192.168.178.67", "192.168.178.144", "192.168.178.191"], "HTTP client handle"=0, "NodesOnline"=[], "ListBoxRef"=refnum}, required
outputs:
  "Error Out": error
  "UIFunction_Out": "UI_FunctionProps.gtype"
  "T Graphs": cluster{"Element 1": f64[], "Element 2": f64[]}[]
  "RH Graphs": cluster{"Element 1": f64[], "Element 2": f64[]}[]  # Reads the file data from all nodes
types:
  "Client Handle.gtype" = u32
  "UI_FunctionProps.gtype" = cluster{"HTTP_BaseStrings": string[], "HTTP client handle": "Client Handle.gtype", "NodesOnline": bool[], "ListBoxRef": "Listbox reference"}
uses:
  WebApp::NodeCommunication::GetFileList.gvi
  WebApp::NodeCommunication::GetFileData.gvi
diagram:
  case ($"Error In") {
    frame Error, Default {
      w1 = $"Error In"
      w2 = $UIFunction_In
      w3 = default
      w4 = default
    }
    frame No Error {
      Property Node(instance in=$UIFunction_In) -> ("ListBoxRef"=w5, "HTTP client handle"=w6, "HTTP_BaseStrings"=w7, "NodesOnline"=w8, instance out=w2)
      Property Node(instance in=w5) -> ("Items"=w9, "Value"=w10)
      Array Index(array=w9) -> (out0[w10]=w11)
      s1 = w6  # shift register
      for {
        w12 = each element of w8
        w13 = each element of w7
        case (w12) {
          frame False, Default {
            w19 = cluster{"Element 1": f64[], "Element 2": f64[]} {"Element 1"=[NaN], "Element 2"=[NaN]}
            w15 = s1
            w16 = $"Error In"
            w17 = w19
            w18 = w19
          }
          frame True {
            call "GetFileList.gvi"(client handle=s1, BaseURL=w13, Error In=$"Error In") -> (client handle out=w20, value=w21, error out=w22)
            Search 1D Array(1D array=w21, element=w11) -> (index of element=w23)
            case (w23) {
              frame -1 {
                w24 = cluster{"Element 1": f64[], "Element 2": f64[]} {"Element 1"=[NaN], "Element 2"=[NaN]}
                w16 = w22
                w15 = w20
                w18 = w24
                w17 = w24
              }
              frame 0, Default {
                call "GetFileData.gvi"(client handle=w20, BaseURL=w13, FileName=w11, Error in=w22) -> (client handle out=w15, AveragedData=w25, error out=w16)
                Property Node(instance in=w25) -> ("Time"=w26, "Temp"=w27, "RH"=w28)
                Build Cluster(w26, w27) -> w17
                Build Cluster(w26, w28) -> w18
              }
            }
          }
        }
        append w16 to w14
        append w17 to w3
        append w18 to w4
        next s1 = w15
      }
      Merge Errors(w14) -> (error out=w1)
    }
  }
  $UIFunction_Out <- w2
  $"T Graphs" <- w3
  $"RH Graphs" <- w4
  $"Error Out" <- w1
