vi "UIFunctions_GetFileList.gvi"   [LabVIEW NXG 3.0.0]
inputs:
  "Error In": error
  "UIFunction_In": "UI_FunctionProps.gtype" = {"HTTP_BaseStrings"=["192.168.178.67", "192.168.178.144", "192.168.178.191"], "HTTP client handle"=0, "NodesOnline"=[], "ListBoxRef"=refnum}, required
outputs:
  "Error Out": error
  "UIFunction_Out": "UI_FunctionProps.gtype"
types:
  "Client Handle.gtype" = u32
  "UI_FunctionProps.gtype" = cluster{"HTTP_BaseStrings": string[], "HTTP client handle": "Client Handle.gtype", "NodesOnline": bool[], "ListBoxRef": "Listbox reference"}
uses:
  WebApp::NodeCommunication::GetFileList.gvi
diagram:
  case ($"Error In") {
    frame Error, Default {
      w1 = $"Error In"
      w2 = $UIFunction_In
    }
    frame No Error {
      Property Node(instance in=$UIFunction_In) -> ("ListBoxRef"=w3, "HTTP client handle"=w4, "HTTP_BaseStrings"=w5, "NodesOnline"=w6, instance out=w2)
      s1 = w4  # shift register
      for {
        w7 = each element of w6
        w8 = each element of w5
        case (w7) {
          frame False, Default {
            w10 = s1
            w11 = $"Error In"
            w12 = default
          }
          frame True {
            call "GetFileList.gvi"(client handle=s1, BaseURL=w8, Error In=$"Error In") -> (client handle out=w10, value=w12, error out=w11)
          }
        }
        concatenate w12 onto w9
        next s1 = w10
      }
      s2 = string[] []  # shift register
      for {
        w13 = each element of w9
        Search 1D Array(1D array=s2, element=w13) -> (index of element=w14)
        case (w14) {
          frame 0, Default {
            w15 = s2
          }
          frame -1 {
            Build Array(s2, w13) -> w15
          }
        }
        next s2 = w15
      }
      Sort 1D Array(array=s2) -> (sorted array=w16)
      Property Node(instance in=w3, "Items"=w16, "Value"=0)
      Merge Errors(w11) -> (error out=w1)
    }
  }
  $UIFunction_Out <- w2
  $"Error Out" <- w1
