vi "UIFunctions_GetMinMaxValues.gvi"   [LabVIEW NXG 3.0.0]
inputs:
  "Error In": error
  "UIFunction_In": "UI_FunctionProps.gtype" = {"HTTP_BaseStrings"=["192.168.178.67", "192.168.178.144", "192.168.178.191"], "HTTP client handle"=0, "NodesOnline"=[], "ListBoxRef"=refnum}, required
outputs:
  "Error Out": error
  "UIFunction_Out": "UI_FunctionProps.gtype"
  "T Graphs": cluster{"Element 1": f64[], "Element 2": f64[]}[]
  "RH Graphs": cluster{"Element 1": f64[], "Element 2": f64[]}[]
  "RH Strings": string[]
  "T Strings": string[]
types:
  "Client Handle.gtype" = u32
  "UI_FunctionProps.gtype" = cluster{"HTTP_BaseStrings": string[], "HTTP client handle": "Client Handle.gtype", "NodesOnline": bool[], "ListBoxRef": "Listbox reference"}
uses:
  WebApp::UI_Functions::UIFunctions_GetDebug.gvi
  WebApp::NodeCommunication::GetHistoricalMinMax.gvi
  WebApp::UI_Functions::UIFunctions_FormatMinMaxString.gvi
diagram:
  case ($"Error In") {
    frame Error, Default {
      w1 = $"Error In"
      w2 = $UIFunction_In
      w3 = default
      w4 = default
      w5 = default
      w6 = default
    }
    frame No Error {
      call "UIFunctions_GetDebug.gvi"(UIFunction_In=$UIFunction_In, Error In=$"Error In") -> (UIFunction_Out=w7, DebugCluster=w8, Error Out=w9)
      Property Node(instance in=w7) -> ("HTTP client handle"=w10, "HTTP_BaseStrings"=w11, "NodesOnline"=w12, instance out=w2)
      s1 = w10  # shift register
      for {
        w13 = each element of w12
        w14 = each element of w11
        w15 = each element of w8
        case (w13) {
          frame False, Default {
            w23 = [{"Element 1"=[NaN], "Element 2"=[NaN]}, {"Element 1"=[NaN], "Element 2"=[NaN]}]
            w17 = s1
            w18 = w9
            w19 = w23
            w20 = w23
            w21 = "Offline"
            w22 = "Offline"
          }
          frame True {
            call "GetHistoricalMinMax.gvi"(client handle=s1, BaseURL=w14, Error in=w9) -> (client handle out=w17, HistMinMax=w24, error out=w18)
            call "UIFunctions_FormatMinMaxString.gvi"(RH?=FALSE, debug in=w15, HistMinMax=w24) -> (MinMaxString=w21)
            call "UIFunctions_FormatMinMaxString.gvi"(RH?=TRUE, debug in=w15, HistMinMax=w24) -> (MinMaxString=w22)
            Property Node(instance in=w24) -> ("Time"=w25, "Temp Max"=w26, "Temp Min"=w27, "RH Max"=w28, "RH Min"=w29)
            Build Cluster(w25, w26) -> w30
            Build Cluster(w25, w27) -> w31
            Build Array(w30, w31) -> w20
            Build Cluster(w25, w28) -> w32
            Build Cluster(w25, w29) -> w33
            Build Array(w32, w33) -> w19
          }
        }
        append w18 to w16
        concatenate w20 onto w3
        concatenate w19 onto w4
        append w21 to w5
        append w22 to w6
        next s1 = w17
      }
      Merge Errors(w16) -> (error out=w1)
    }
  }
  $UIFunction_Out <- w2
  $"T Strings" <- w5
  $"RH Strings" <- w6
  $"T Graphs" <- w3
  $"RH Graphs" <- w4
  $"Error Out" <- w1
