vi "UI_Historical.gvi"   [LabVIEW NXG 3.0.0]
inputs:
  "Input": "Client Handle.gtype"
  "Error": error
  "Base URL": string[]
  "Filenames": string[]
outputs:
  "Output": "Client Handle.gtype"
  "Error out": error
  "Graphs": cluster{"Element 1": f64[], "Element 2": f64[]}[]
  "Graphs_2": cluster{"Element 1": f64[], "Element 2": f64[]}[]
types:
  "Client Handle.gtype" = u32
uses:
  WebApp::NodeCommunication::GetFileData.gvi
diagram:
  case ($Error) {
    frame Error, Default {
      w1 = $Input
      w2 = $Error
      w3 = default
      w4 = default
    }
    frame No Error {
      s1 = $Input  # shift register
      s2 = $Error  # shift register
      for {
        w5 = each element of $"Base URL"
        w6 = each element of $Filenames
        call "GetFileData.gvi"(client handle=s1, BaseURL=w5, FileName=w6, Error in=s2) -> (client handle out=w8, AveragedData=w9, error out=w10)
        Property Node(instance in=w9) -> ("Time"=w11, "Temp"=w12, "RH"=w13)
        Build Cluster(w11, w12) -> w14
        Build Cluster(w11, w13) -> w15
        Build Array(w14, w15) -> w16
        concatenate w16 onto w7
        next s1 = w8
        next s2 = w10
      }
      Delete From Array(inArray=w7, length (1)=2) -> (outArray=w3, deleted=w4)
      w1 = s1
      w2 = s2
    }
  }
  $Graphs <- w3
  $Graphs_2 <- w4
  $Output <- w1
  $"Error out" <- w2
