vi "UI_HistoricalMinMax.gvi"   [LabVIEW NXG 3.0.0]
inputs:
  "Input": "Client Handle.gtype"
  "Error": error
  "Base URL": string[]
outputs:
  "Output": "Client Handle.gtype"
  "Error out": error
  "GraphsT": cluster{"Element 1": f64[], "Element 2": f64[]}[]
  "GraphsRH": cluster{"Element 1": f64[], "Element 2": f64[]}[]
  "RH Strings": string[]
  "T strings": string[]
types:
  "Client Handle.gtype" = u32
uses:
  WebApp::NodeCommunication::GetDebug.gvi
  WebApp::NodeCommunication::GetHistoricalMinMax.gvi
diagram:
  case ($Error) {
    frame Error, Default {
      w1 = $Input
      w2 = $Error
      w3 = default
      w4 = default
      w5 = default
      w6 = default
    }
    frame No Error {
      s1 = $Input  # shift register
      for {
        w7 = each element of $"Base URL"
        call "GetDebug.gvi"(client handle=s1, BaseURL=w7, error in=$Error) -> (client handle out=w9, Debug=w10, error out=w11)
        Property Node(instance in=w10) -> ("Location"=w12)
        call "GetHistoricalMinMax.gvi"(client handle=w9, BaseURL=w7, Error in=w11) -> (client handle out=w13, HistMinMax=w14, error out=w15)
        Property Node(instance in=w14) -> ("Time"=w16, "Temp Max"=w17, "Temp Min"=w18, "RH Max"=w19, "RH Min"=w20)
        Array Max And Min(array=w17) -> (max index(es)=w21, max value=w22)
        Array Max And Min(array=w18) -> (min index(es)=w23, min value=w24)
        Array Index(array=w16) -> (out0[w21]=w25)
        To Time Stamp(number=w25) -> w26
        Format Date Time String(time format string (%c)="%d %B %y", time stamp=w26) -> (date/time string=w27)
        Array Index(array=w16) -> (out0[w23]=w28)
        To Time Stamp(number=w28) -> w29
        Format Date Time String(time format string (%c)="%d %B %y", time stamp=w29) -> (date/time string=w30)
        Format Into String(formatString="Node: %s Temperature: Max %.3f at %s - Min %.3f at %s", w12, w22, w27, w24, w30) -> w31
        Array Max And Min(array=w19) -> (max index(es)=w32, max value=w33)
        Array Max And Min(array=w20) -> (min index(es)=w34, min value=w35)
        Array Index(array=w16) -> (out0[w32]=w36)
        To Time Stamp(number=w36) -> w37
        Format Date Time String(time format string (%c)="%d %B %y", time stamp=w37) -> (date/time string=w38)
        Array Index(array=w16) -> (out0[w34]=w39)
        To Time Stamp(number=w39) -> w40
        Format Date Time String(time format string (%c)="%d %B %y", time stamp=w40) -> (date/time string=w41)
        Format Into String(formatString="Node: %s RH: Max %.3f at %s - Min %.3f at %s", w12, w33, w38, w35, w41) -> w42
        Build Cluster(w16, w17) -> w43
        Build Cluster(w16, w18) -> w44
        Build Array(w43, w44) -> w45
        Build Cluster(w16, w19) -> w46
        Build Cluster(w16, w20) -> w47
        Build Array(w46, w47) -> w48
        concatenate w45 onto w3
        concatenate w48 onto w4
        append w31 to w5
        append w42 to w6
        append w15 to w8
        next s1 = w13
      }
      Merge Errors(w8) -> (error out=w2)
      w1 = s1
    }
  }
  $"T strings" <- w5
  $"RH Strings" <- w6
  $GraphsT <- w3
  $GraphsRH <- w4
  $Output <- w1
  $"Error out" <- w2
